# Grasshopper definition @Matrix_Operations.gh (Grasshopper 1.0.7)

# ----
# Create Matrix
rows = Slider(3, range=0..10)
cols = Slider(4, range=0..10)
value = Slider(4.434, range=0..10)
c_creatematrix = CSharpScript(rows=rows, cols=cols, Value=value)  # -> out, A; inputs rows: Int32, cols: Int32, Value: Double
# ---------- c_creatematrix: C# ----------
    double[][] m = MatrixCreate(rows, cols);

    //////Define Tree//////
    DataTree<double> doubleTree = new DataTree<double>();

    // Raws = Branches
    for(int i = 0; i < m.Length;i++)
    {
      GH_Path pth = new GH_Path(i);

      // Cols = Index
      for (int j = 0; j < m[i].Length;j++)
      {
        doubleTree.Add(Value, pth);
      }
    }
    //////Define Tree End//////

    A = doubleTree;
# ---------- c_creatematrix: C# additional code ----------
  static double[][] MatrixCreate(int rows, int cols)
  {
    double[][] result = new double[rows][];

    for (int i = 0; i < rows; ++i)
    {
      result[i] = new double[cols];
    }
    return result;
  }

  // Resource: https://jamesmccaffrey.wordpress.com/2015/03/06/inverting-a-matrix-using-c/
  // Editor: Taeyong Kim
# ---------- end c_creatematrix ----------
panel = Panel(c_creatematrix.A)

# ----
# Random Matrix
number_slider = Slider(3, range=0..10)
min = Slider(0, range=0..10)
max = Slider(3.73, range=0..10)
seed = Slider(3, range=0..10)
c_randommatrix = CSharpScript(rows=number_slider, cols=Slider(3, range=0..10), minVal=min, maxVal=max, seed=seed)  # -> out, A; inputs rows: Int32, cols: Int32, minVal: Double, maxVal: Double, seed: Int32
# ---------- c_randommatrix: C# ----------
    double[][] m = MatrixRandom(rows, cols, minVal, maxVal, seed);

    //////Define Tree//////
    DataTree < double > doubleTree = new DataTree<double>();

    // Raws = Branches
    for(int i = 0; i < m.Length;i++)
    {
      GH_Path pth = new GH_Path(i);

      // Cols = Index
      for (int j = 0; j < m[i].Length;j++)
      {
        doubleTree.Add(m[i][j], pth);
      }
    }
    //////Define Tree End//////

    A = doubleTree;
# ---------- c_randommatrix: C# additional code ----------
  static double[][] MatrixCreate(int rows, int cols)
  {
    double[][] result = new double[rows][];

    for (int i = 0; i < rows; ++i)
    {
      result[i] = new double[cols];
    }
    return result;
  }


  static double[][] MatrixRandom(int rows, int cols, double minVal, double maxVal, int seed)
  {
    // return a matrix with random values
    Random ran = new Random(seed);
    double[][] result = MatrixCreate(rows, cols);
    for (int i = 0; i < rows; ++i)
    {
      for (int j = 0; j < cols; ++j)
      {
        result[i][j] = (maxVal - minVal) * ran.NextDouble() + minVal;
      }
    }
    return result;
  }

  // Resource: https://jamesmccaffrey.wordpress.com/2015/03/06/inverting-a-matrix-using-c/
  // Editor: Taeyong Kim
# ---------- end c_randommatrix ----------
panel_2 = Panel(c_randommatrix.A)

min_2 = Slider(0, range=0..10)
# Equal Matrix
number_slider_2 = Slider(5, range=0..10)
max_2 = Slider(3.73, range=0..10)
seed_2 = Slider(5, range=0..10)
min_3 = Slider(0, range=0..10)
max_3 = Slider(3.73, range=0..10)
seed_3 = Slider(4, range=0..10)
c_randommatrix_2 = CSharpScript(rows=number_slider_2, cols=Slider(5, range=0..10), minVal=min_2, maxVal=max_2, seed=seed_2)  # -> out, A; inputs rows: Int32, cols: Int32, minVal: Double, maxVal: Double, seed: Int32; same code as c_randommatrix
c_randommatrix_3 = CSharpScript(rows=Slider(5, range=0..10), cols=Slider(5, range=0..10), minVal=min_3, maxVal=max_3, seed=seed_3)  # -> out, A; inputs rows: Int32, cols: Int32, minVal: Double, maxVal: Double, seed: Int32; same code as c_randommatrix
epsilon = Slider(0, range=0..10)
epsilon_2 = Slider(0, range=0..10)
c_matrix_a_b = CSharpScript(Tree_Matrix_A=c_randommatrix_3.A, Tree_Matrix_B=c_randommatrix_3.A, epsilon=epsilon_2)  # -> out, A; inputs Tree_Matrix_A: tree of Double, Tree_Matrix_B: tree of Double, epsilon: Double
# ---------- c_matrix_a_b: C# ----------
    A = MatrixAreEqual_Grasshopper(Tree_Matrix_A, Tree_Matrix_B, epsilon);
# ---------- c_matrix_a_b: C# additional code ----------
  //returns "string" or "double[][]"
  static dynamic MatrixAreEqual_Original(double[][] matrixA, double[][] matrixB, double epsilon)
  {
    // true if all values in matrixA == values in matrixB
    int aRows = matrixA.Length;
    int aCols = matrixA[0].Length;

    int bRows = matrixB.Length;
    int bCols = matrixB[0].Length;

    if (aRows != bRows || aCols != bCols)
    {
      return "Non-conformable matrices";
    }

    for (int i = 0; i < aRows; ++i) // each row of A and B
    {
      for (int j = 0; j < aCols; ++j) // each col of A and B
      {
        //if (matrixA[i][j] != matrixB[i][j])

        if (Math.Abs(matrixA[i][j] - matrixB[i][j]) > epsilon)
        {
          return false;
        }
      }
    }
    return true;
  }

  //returns "string" or "DataTree<double>"
  static dynamic MatrixAreEqual_Grasshopper(DataTree<double> matrixA, DataTree<double> matrixB, double epsilon)
  {
    // true if all values in matrixA == values in matrixB
    IList<List<double>> matrixA_Branches = matrixA.Branches;
    int aRows = matrixA_Branches.Count; int aCols = matrixA_Branches[0].Count;

    IList<List<double>> matrixB_Branches = matrixB.Branches;
    int bRows = matrixB_Branches.Count; int bCols = matrixB_Branches[0].Count;

    if (aRows != bRows || aCols != bCols)
    {
      return "Non-conformable matrices";
    }

    for (int i = 0; i < aRows; ++i) // each row of A and B
    {
      for (int j = 0; j < aCols; ++j) // each col of A and B
      {
        //if (matrixA[i][j] != matrixB[i][j])
        if (Math.Abs(matrixA_Branches[i][j] - matrixB_Branches[i][j]) > epsilon)
        {
          return false;
        }
      }
    }

    return true;
  }
  // Resource: https://jamesmccaffrey.wordpress.com/2015/03/06/inverting-a-matrix-using-c/
  // Resource: https://www.storyofmathematics.com/equivalent-matrices
  // Editor: Taeyong Kim
# ---------- end c_matrix_a_b ----------
c_matrix_a_b_2 = CSharpScript(Tree_Matrix_A=c_randommatrix_2.A, Tree_Matrix_B=c_randommatrix_3.A, epsilon=epsilon)  # -> out, A; inputs Tree_Matrix_A: tree of Double, Tree_Matrix_B: tree of Double, epsilon: Double; same code as c_matrix_a_b
panel_3 = Panel(c_matrix_a_b.A)
panel_4 = Panel(c_matrix_a_b_2.A)

min_4 = Slider(0, range=0..10)
# Dot Product
number_slider_3 = Slider(2, range=0..10)
min_5 = Slider(0, range=0..10)
max_4 = Slider(3.73, range=0..10)
seed_4 = Slider(5, range=0..10)
max_5 = Slider(3.73, range=0..10)
seed_5 = Slider(4, range=0..10)
c_randommatrix_4 = CSharpScript(rows=number_slider_3, cols=Slider(5, range=0..10), minVal=min_5, maxVal=max_4, seed=seed_4)  # -> out, A; inputs rows: Int32, cols: Int32, minVal: Double, maxVal: Double, seed: Int32; same code as c_randommatrix
c_randommatrix_5 = CSharpScript(rows=Slider(5, range=0..10), cols=Slider(3, range=0..10), minVal=min_4, maxVal=max_5, seed=seed_5)  # -> out, A; inputs rows: Int32, cols: Int32, minVal: Double, maxVal: Double, seed: Int32; same code as c_randommatrix
c_matrix_a_dot_product_b = CSharpScript(Tree_axb_Matrix=c_randommatrix_4.A, Tree_bxa_Matrix=c_randommatrix_5.A)  # -> out, A; inputs Tree_axb_Matrix: tree of Double, Tree_bxa_Matrix: tree of Double
# ---------- c_matrix_a_dot_product_b: C# ----------
    if(MatrixProduct_Grasshopper(Tree_axb_Matrix, Tree_bxa_Matrix).GetType() == typeof(string))
    {
      A = "Non-conformable matrices";
    }
    else
    {
      double[][] m = MatrixProduct_Grasshopper(Tree_axb_Matrix, Tree_bxa_Matrix);

      //////Define Tree//////
      DataTree < double > doubleTree = new DataTree<double>();

      // Raws = Branches
      for(int i = 0; i < m.Length;i++)
      {
        GH_Path pth = new GH_Path(i);

        // Cols = Index
        for (int j = 0; j < m[i].Length;j++)
        {
          doubleTree.Add(m[i][j], pth);
        }
      }
      //////Define Tree End//////

      A = doubleTree;
    }
# ---------- c_matrix_a_dot_product_b: C# additional code ----------
  static double[][] MatrixCreate(int rows, int cols)
  {
    double[][] result = new double[rows][];

    for (int i = 0; i < rows; ++i)
    {
      result[i] = new double[cols];
    }
    return result;
  }

  //returns "string" or "double[][]"
  static dynamic MatrixProduct_Original(double[][] matrixA, double[][] matrixB)
  {
    int aRows = matrixA.Length; int aCols = matrixA[0].Length;
    int bRows = matrixB.Length; int bCols = matrixB[0].Length;
    if (aCols != bRows)
    {
      return "Non-conformable matrices";
    }

    double[][] result = MatrixCreate(aRows, bCols);

    for (int i = 0; i < aRows; ++i) // each row of A
      for (int j = 0; j < bCols; ++j) // each col of B
        for (int k = 0; k < aCols; ++k) // could use k less-than bRows
          result[i][j] += matrixA[i][k] * matrixB[k][j];

    return result;
  }

  //returns "string" or "DataTree<double>"
  static dynamic MatrixProduct_Grasshopper(DataTree<double> matrixA, DataTree<double> matrixB)
  {
    IList<List<double>> matrixA_Branches = matrixA.Branches;
    int aRows = matrixA_Branches.Count; int aCols = matrixA_Branches[0].Count;

    IList<List<double>> matrixB_Branches = matrixB.Branches;
    int bRows = matrixB_Branches.Count; int bCols = matrixB_Branches[0].Count;

    if (aCols != bRows)
    {
      return "Non-conformable matrices";
    }

    double[][] result = MatrixCreate(aRows, bCols);

    for (int i = 0; i < aRows; ++i) // each row of A
    {
      for (int j = 0; j < bCols; ++j) // each col of B
      {
        for (int k = 0; k < aCols; ++k) // could use k less-than bRows
        {
          result[i][j] += matrixA_Branches[i][k] * matrixB_Branches[k][j];
        }
      }
    }

    return result;
  }
  // Resource#1: https://jamesmccaffrey.wordpress.com/2015/03/06/inverting-a-matrix-using-c/
  // Resource#2: https://en.wikipedia.org/wiki/Matrix_multiplication
  // Editor: Taeyong Kim.
# ---------- end c_matrix_a_dot_product_b ----------
panel_5 = Panel(c_matrix_a_dot_product_b.A)

max_6 = Slider(3.73, range=0..10)
seed_6 = Slider(5, range=0..10)
# Identity Matrix
number_slider_4 = Slider(5, range=0..10)
min_6 = Slider(0, range=0..10)
c_identitymatrix = CSharpScript(Row_Col_Length=Slider(5, range=0..10))  # -> out, A; inputs Row_Col_Length: Int32
# ---------- c_identitymatrix: C# ----------
    double[][] m = MatrixIdentity(Row_Col_Length);

    //////Define Tree//////
    DataTree < double > doubleTree = new DataTree<double>();

    // Raws = Branches
    for(int i = 0; i < m.Length;i++)
    {
      GH_Path pth = new GH_Path(i);

      // Cols = Index
      for (int j = 0; j < m[i].Length;j++)
      {
        doubleTree.Add(m[i][j], pth);
      }
    }
    //////Define Tree End//////

    A = doubleTree;
# ---------- c_identitymatrix: C# additional code ----------
  static double[][] MatrixCreate(int rows, int cols)
  {
    double[][] result = new double[rows][];

    for (int i = 0; i < rows; ++i)
    {
      result[i] = new double[cols];
    }
    return result;
  }


  static double[][] MatrixIdentity(int n)
  {
    // return an n x n Identity matrix
    double[][] result = MatrixCreate(n, n);
    for (int i = 0; i < n; ++i)
    {
      result[i][i] = 1.0;
    }

    return result;
  }

  // Resource#1: https://jamesmccaffrey.wordpress.com/2015/03/06/inverting-a-matrix-using-c/
  // Resource#2: https://en.wikipedia.org/wiki/Identity_matrix
  // Editor: Taeyong Kim
# ---------- end c_identitymatrix ----------
c_randommatrix_6 = CSharpScript(rows=number_slider_4, cols=Slider(5, range=0..10), minVal=min_6, maxVal=max_6, seed=seed_6)  # -> out, A; inputs rows: Int32, cols: Int32, minVal: Double, maxVal: Double, seed: Int32; same code as c_randommatrix
c_matrix_a_dot_product_b_2 = CSharpScript(Tree_axb_Matrix=c_randommatrix_6.A, Tree_bxa_Matrix=c_identitymatrix.A)  # -> out, A; inputs Tree_axb_Matrix: tree of Double, Tree_bxa_Matrix: tree of Double; same code as c_matrix_a_dot_product_b
panel_6 = Panel(c_matrix_a_dot_product_b_2.A)

# ----
# Vector Product
number_slider_5 = Slider(2, range=0..10)
min_7 = Slider(0, range=0..10)
max_7 = Slider(3.73, range=0..10)
seed_7 = Slider(5, range=0..10)
min_8 = Slider(0, range=0..10)
max_8 = Slider(3.73, range=0..10)
seed_8 = Slider(4, range=0..10)
c_randommatrix_7 = CSharpScript(rows=Slider(1, range=0..10), cols=Slider(5, range=0..10), minVal=min_8, maxVal=max_8, seed=seed_8)  # -> out, flatten(A); inputs rows: Int32, cols: Int32, minVal: Double, maxVal: Double, seed: Int32; same code as c_randommatrix
c_randommatrix_8 = CSharpScript(rows=number_slider_5, cols=Slider(5, range=0..10), minVal=min_7, maxVal=max_7, seed=seed_7)  # -> out, A; inputs rows: Int32, cols: Int32, minVal: Double, maxVal: Double, seed: Int32; same code as c_randommatrix
c_matrix_a_mxv_product_b = CSharpScript(Tree_axb_Matrix=c_randommatrix_8.A, Array_1xb_Vector=c_randommatrix_7.A)  # -> out, A; inputs Tree_axb_Matrix: tree of Double, Array_1xb_Vector: list of Double
# ---------- c_matrix_a_mxv_product_b: C# ----------
    if(MatrixVectorProduct_Grasshopper(Tree_axb_Matrix, Array_1xb_Vector.ToArray()).GetType() == typeof(string))
    {
      A = "Non-conformable matrices";
    }
    else
    {
      A = MatrixVectorProduct_Grasshopper(Tree_axb_Matrix, Array_1xb_Vector.ToArray());
    }
# ---------- c_matrix_a_mxv_product_b: C# additional code ----------
  static double[][] MatrixCreate(int rows, int cols)
  {
    double[][] result = new double[rows][];

    for (int i = 0; i < rows; ++i)
    {
      result[i] = new double[cols];
    }
    return result;
  }
  //returns "string" or "double[][]"
  static dynamic MatrixVectorProduct_Original(double[][] matrix, double[] vector)
  {
    // result of multiplying an n x m matrix by a m x 1
    // column vector (yielding an n x 1 column vector)
    int mRows = matrix.Length; int mCols = matrix[0].Length;
    int vRows = vector.Length;
    if (mCols != vRows)
    {
      return "Non-conformable matrices";
    }
    double[] result = new double[mRows];
    {
      for (int i = 0; i < mRows; ++i)
      {
        for (int j = 0; j < mCols; ++j)
        {
          result[i] += matrix[i][j] * vector[j];
        }
      }
    }
    return result;
  }

  //returns "string" or "DataTree<double>"
  static dynamic MatrixVectorProduct_Grasshopper(DataTree<double> matrix, double[] vector)
  {
    // result of multiplying an n x m matrix by a m x 1
    // column vector (yielding an n x 1 column vector)
    IList<List<double>> matrix_Branches = matrix.Branches;
    int mRows = matrix_Branches.Count; int mCols = matrix_Branches[0].Count;

    int vRows = vector.Length;


    if (mCols != vRows)
    {
      return "Non-conformable matrices";
    }
    double[] result = new double[mRows];
    {
      for (int i = 0; i < mRows; ++i)
      {
        for (int j = 0; j < mCols; ++j)
        {
          result[i] += matrix_Branches[i][j] * vector[j];
        }
      }
    }
    return result;
  }

  // Resource#1: https://jamesmccaffrey.wordpress.com/2015/03/06/inverting-a-matrix-using-c/
  // Resource#2: https://mathinsight.org/matrix_vector_multiplication
  // Editor: Taeyong Kim.
# ---------- end c_matrix_a_mxv_product_b ----------
panel_7 = Panel(c_matrix_a_mxv_product_b.A)

min_9 = Slider(0, range=0..10)
# LUP Decompose
number_slider_6 = Slider(5, range=0..10)
max_9 = Slider(3.73, range=0..10)
seed_9 = Slider(5, range=0..10)
c_randommatrix_9 = CSharpScript(rows=number_slider_6, cols=Slider(5, range=0..10), minVal=min_9, maxVal=max_9, seed=seed_9)  # -> out, A; inputs rows: Int32, cols: Int32, minVal: Double, maxVal: Double, seed: Int32; same code as c_randommatrix
c_matrix_lup_decompose = CSharpScript(Tree_axa_Matrix=c_randommatrix_9.A)  # -> out, result_Matrix, permutations, toggle_even_v_Odd; inputs Tree_axa_Matrix: tree of Double
# ---------- c_matrix_lup_decompose: C# ----------
    int[] perm;
    int toggle;
    string status;

    double[][] m = MatrixDecompose_Grasshopper(Tree_axa_Matrix, out perm, out toggle, out status);

    if(status == "Cannot use Doolittle's method")
    {
      result_Matrix = status;
    }
    else if(status == "Attempt to decompose a non-square m")
    {
      result_Matrix = status;
    }
    else
    {

      //////Define Tree//////
      DataTree < double > doubleTree = new DataTree<double>();

      // Raws = Branches
      for(int i = 0; i < m.Length;i++)
      {
        GH_Path pth = new GH_Path(i);

        // Cols = Index
        for (int j = 0; j < m[i].Length;j++)
        {
          doubleTree.Add(m[i][j], pth);
        }
      }
      //////Define Tree End//////

      permutations = perm;
      toggle_even_v_Odd = toggle;
      result_Matrix = doubleTree;
    }
# ---------- c_matrix_lup_decompose: C# additional code ----------
  static double[][] MatrixCreate(int rows, int cols)
  {
    double[][] result = new double[rows][];

    for (int i = 0; i < rows; ++i)
    {
      result[i] = new double[cols];
    }
    return result;
  }

  static double[][] MatrixDuplicate(double[][] matrix)
  {
    // allocates/creates a duplicate of a matrix.
    double[][] result = MatrixCreate(matrix.Length, matrix[0].Length);
    for (int i = 0; i < matrix.Length; ++i) // copy the values
    {
      for (int j = 0; j < matrix[i].Length; ++j)
      {
        result[i][j] = matrix[i][j];
      }
    }
    return result;
  }

  //////////////////////////////////
  static double[][] MatrixDecompose_Original(double[][] matrix, out int[] perm, out int toggle)
  {
    // Doolittle LUP decomposition with partial pivoting.
    // rerturns: result is L (with 1s on diagonal) and U;
    // perm holds row permutations; toggle is +1 or -1 (even or odd)
    int rows = matrix.Length;
    int cols = matrix[0].Length; // assume square

    if (rows != cols)
    {
      throw new Exception("Attempt to decompose a non-square m");
    }

    int n = rows; // convenience

    double[][] result = MatrixDuplicate(matrix);

    perm = new int[n]; // set up row permutation result
    for (int i = 0; i < n; ++i) { perm[i] = i; }

    toggle = 1; // toggle tracks row swaps.
    // +1 -greater-than even, -1 -greater-than odd. used by MatrixDeterminant

    for (int j = 0; j < n - 1; ++j) // each column
    {
      double colMax = Math.Abs(result[j][j]); // find largest val in col
      int pRow = j;
      //for (int i = j + 1; i less-than n; ++i)
      //{
      //  if (result[i][j] greater-than colMax)
      //  {
      //    colMax = result[i][j];
      //    pRow = i;
      //  }
      //}

      // reader Matt V needed this:
      for (int i = j + 1; i < n; ++i)
      {
        if (Math.Abs(result[i][j]) > colMax)
        {
          colMax = Math.Abs(result[i][j]);
          pRow = i;
        }
      }
      // Not sure if this approach is needed always, or not.

      if (pRow != j) // if largest value not on pivot, swap rows
      {
        double[] rowPtr = result[pRow];
        result[pRow] = result[j];
        result[j] = rowPtr;

        int tmp = perm[pRow]; // and swap perm info
        perm[pRow] = perm[j];
        perm[j] = tmp;

        toggle = -toggle; // adjust the row-swap toggle
      }

      // --------------------------------------------------
      // This part added later (not in original)
      // and replaces the 'return null' below.
      // if there is a 0 on the diagonal, find a good row
      // from i = j+1 down that doesn't have
      // a 0 in column j, and swap that good row with row j
      // --------------------------------------------------

      if (result[j][j] == 0.0)
      {
        // find a good row to swap
        int goodRow = -1;
        for (int row = j + 1; row < n; ++row)
        {
          if (result[row][j] != 0.0)
            goodRow = row;
        }

        if (goodRow == -1)
        {

          throw new Exception("Cannot use Doolittle's method");
        }

        // swap rows so 0.0 no longer on diagonal
        double[] rowPtr = result[goodRow];
        result[goodRow] = result[j];
        result[j] = rowPtr;

        int tmp = perm[goodRow]; // and swap perm info
        perm[goodRow] = perm[j];
        perm[j] = tmp;

        toggle = -toggle; // adjust the row-swap toggle
      }
      // --------------------------------------------------
      // if diagonal after swap is zero . .
      //if (Math.Abs(result[j][j]) less-than 1.0E-20)
      //  return null; // consider a throw

      for (int i = j + 1; i < n; ++i)
      {
        result[i][j] /= result[j][j];
        for (int k = j + 1; k < n; ++k)
        {
          result[i][k] -= result[i][j] * result[j][k];
        }
      }


    } // main j column loop

    return result;
  } // MatrixDecompose

  //////////////////////////////////
  static double[][] MatrixDecompose_Grasshopper(DataTree<double> matrix, out int[] perm, out int toggle, out string status)
  {
    // Doolittle LUP decomposition with partial pivoting.
    // rerturns: result is L (with 1s on diagonal) and U;
    // perm holds row permutations; toggle is +1 or -1 (even or odd)
    IList<List<double>> matrix_Branches = matrix.Branches;
    int rows = matrix_Branches.Count; int cols = matrix_Branches[0].Count; // assume square

    status = "Works fine";

    if (rows != cols)
    {
      status = "Attempt to decompose a non-square m";
    }


    //Tree into [][] Start//
    double[][] matrix_TtoM = MatrixCreate(rows, cols);
    for(int i = 0; i < rows; i++)
    {
      for(int j = 0; j < cols; j++)
      {
        matrix_TtoM[i][j] = matrix_Branches[i][j];
      }
    }
    //Tree into [][] End//

    int n = rows; // convenience

    double[][] result = MatrixDuplicate(matrix_TtoM);

    perm = new int[n]; // set up row permutation result

    for (int i = 0; i < n; ++i)
    {
      perm[i] = i;
    }

    toggle = 1; // toggle tracks row swaps.
    // +1 -greater-than even, -1 -greater-than odd. used by MatrixDeterminant

    for (int j = 0; j < n - 1; ++j) // each column
    {
      double colMax = Math.Abs(result[j][j]); // find largest val in col
      int pRow = j;


      // reader Matt V needed this:
      for (int i = j + 1; i < n; ++i)
      {
        if (Math.Abs(result[i][j]) > colMax)
        {
          colMax = Math.Abs(result[i][j]);
          pRow = i;
        }
      }
      // Not sure if this approach is needed always, or not.

      if (pRow != j) // if largest value not on pivot, swap rows
      {
        double[] rowPtr = result[pRow];
        result[pRow] = result[j];
        result[j] = rowPtr;

        int tmp = perm[pRow]; // and swap perm info
        perm[pRow] = perm[j];
        perm[j] = tmp;

        toggle = -toggle; // adjust the row-swap toggle
      }

      // --------------------------------------------------
      // This part added later (not in original)
      // and replaces the 'return null' below.
      // if there is a 0 on the diagonal, find a good row
      // from i = j+1 down that doesn't have
      // a 0 in column j, and swap that good row with row j
      // --------------------------------------------------

      if (result[j][j] == 0.0)
      {
        // find a good row to swap
        int goodRow = -1;
        for (int row = j + 1; row < n; ++row)
        {
          if (result[row][j] != 0.0)
            goodRow = row;
        }

        if (goodRow == -1)
        {
          status = "Cannot use Doolittle's method";
        }

        // swap rows so 0.0 no longer on diagonal
        double[] rowPtr = result[goodRow];
        result[goodRow] = result[j];
        result[j] = rowPtr;

        int tmp = perm[goodRow]; // and swap perm info
        perm[goodRow] = perm[j];
        perm[j] = tmp;

        toggle = -toggle; // adjust the row-swap toggle
      }
      // --------------------------------------------------
      // if diagonal after swap is zero . .
      //if (Math.Abs(result[j][j]) less-than 1.0E-20)
      //  return null; // consider a throw

      for (int i = j + 1; i < n; ++i)
      {
        result[i][j] /= result[j][j];
        for (int k = j + 1; k < n; ++k)
        {
          result[i][k] -= result[i][j] * result[j][k];
        }
      }


    } // main j column loop

    return result;
  } // MatrixDecompose


  // Resource#1: https://jamesmccaffrey.wordpress.com/2015/03/06/inverting-a-matrix-using-c/
  // Resource#2: https://en.wikipedia.org/wiki/LU_decomposition
  // Resource#3: http://mathonline.wikidot.com/doolittle-s-method-for-lu-decompositions
  // Resource#4: https://www.geeksforgeeks.org/doolittle-algorithm-lu-decomposition/
  // Resource#4: http://lampx.tugraz.at/~hadley/num/ch2/2.3a.php
  // Editor: Taeyong Kim.
# ---------- end c_matrix_lup_decompose ----------
panel_8 = Panel(c_matrix_lup_decompose.permutations)

min_10 = Slider(0, range=0..10)
# Inverse Matrix
number_slider_7 = Slider(5, range=0..10)
max_10 = Slider(3.73, range=0..10)
seed_10 = Slider(5, range=0..10)
c_randommatrix_10 = CSharpScript(rows=number_slider_7, cols=Slider(5, range=0..10), minVal=min_10, maxVal=max_10, seed=seed_10)  # -> out, A; inputs rows: Int32, cols: Int32, minVal: Double, maxVal: Double, seed: Int32; same code as c_randommatrix
c_matrix_inverse_matrix = CSharpScript(Tree_axa_Matrix=c_randommatrix_10.A)  # -> out, A; inputs Tree_axa_Matrix: tree of Double
# ---------- c_matrix_inverse_matrix: C# ----------
    if(MatrixInverse_Grasshopper(Tree_axa_Matrix).GetType() == typeof(string))
    {
      A = "Non-conformable matrices";
    }
    else
    {
      double[][] m = MatrixInverse_Grasshopper(Tree_axa_Matrix);

      //////Define Tree//////
      DataTree < double > doubleTree = new DataTree<double>();

      // Raws = Branches
      for(int i = 0; i < m.Length;i++)
      {
        GH_Path pth = new GH_Path(i);

        // Cols = Index
        for (int j = 0; j < m[i].Length;j++)
        {
          doubleTree.Add(m[i][j], pth);
        }
      }
      //////Define Tree End//////

      A = doubleTree;
    }
# ---------- c_matrix_inverse_matrix: C# additional code ----------
  //////////////////////////////////
  static double[][] MatrixCreate(int rows, int cols)
  {
    double[][] result = new double[rows][];

    for (int i = 0; i < rows; ++i)
    {
      result[i] = new double[cols];
    }
    return result;
  }
  //////////////////////////////////

  //////////////////////////////////
  static double[][] MatrixDuplicate(double[][] matrix)
  {
    // allocates/creates a duplicate of a matrix.
    double[][] result = MatrixCreate(matrix.Length, matrix[0].Length);
    for (int i = 0; i < matrix.Length; ++i) // copy the values
    {
      for (int j = 0; j < matrix[i].Length; ++j)
      {
        result[i][j] = matrix[i][j];
      }
    }
    return result;
  }
  //////////////////////////////////

  //////////////////////////////////
  static double[][] MatrixDecompose_Grasshopper(DataTree<double> matrix, out int[] perm, out int toggle, out string status)
  {
    // Doolittle LUP decomposition with partial pivoting.
    // rerturns: result is L (with 1s on diagonal) and U;
    // perm holds row permutations; toggle is +1 or -1 (even or odd)
    IList<List<double>> matrix_Branches = matrix.Branches;
    int rows = matrix_Branches.Count; int cols = matrix_Branches[0].Count; // assume square

    status = "Works fine";

    if (rows != cols)
    {
      status = "Attempt to decompose a non-square m";
    }


    //Tree into [][] Start//
    double[][] matrix_TtoM = MatrixCreate(rows, cols);
    for(int i = 0; i < rows; i++)
    {
      for(int j = 0; j < cols; j++)
      {
        matrix_TtoM[i][j] = matrix_Branches[i][j];
      }
    }
    //Tree into [][] End//

    int n = rows; // convenience

    double[][] result = MatrixDuplicate(matrix_TtoM);

    perm = new int[n]; // set up row permutation result

    for (int i = 0; i < n; ++i)
    {
      perm[i] = i;
    }

    toggle = 1; // toggle tracks row swaps.
    // +1 -greater-than even, -1 -greater-than odd. used by MatrixDeterminant

    for (int j = 0; j < n - 1; ++j) // each column
    {
      double colMax = Math.Abs(result[j][j]); // find largest val in col
      int pRow = j;
      //for (int i = j + 1; i less-than n; ++i)
      //{
      //  if (result[i][j] greater-than colMax)
      //  {
      //    colMax = result[i][j];
      //    pRow = i;
      //  }
      //}

      // reader Matt V needed this:
      for (int i = j + 1; i < n; ++i)
      {
        if (Math.Abs(result[i][j]) > colMax)
        {
          colMax = Math.Abs(result[i][j]);
          pRow = i;
        }
      }
      // Not sure if this approach is needed always, or not.

      if (pRow != j) // if largest value not on pivot, swap rows
      {
        double[] rowPtr = result[pRow];
        result[pRow] = result[j];
        result[j] = rowPtr;

        int tmp = perm[pRow]; // and swap perm info
        perm[pRow] = perm[j];
        perm[j] = tmp;

        toggle = -toggle; // adjust the row-swap toggle
      }

      // --------------------------------------------------
      // This part added later (not in original)
      // and replaces the 'return null' below.
      // if there is a 0 on the diagonal, find a good row
      // from i = j+1 down that doesn't have
      // a 0 in column j, and swap that good row with row j
      // --------------------------------------------------

      if (result[j][j] == 0.0)
      {
        // find a good row to swap
        int goodRow = -1;
        for (int row = j + 1; row < n; ++row)
        {
          if (result[row][j] != 0.0)
            goodRow = row;
        }

        if (goodRow == -1)
        {
          status = "Cannot use Doolittle's method";
        }

        // swap rows so 0.0 no longer on diagonal
        double[] rowPtr = result[goodRow];
        result[goodRow] = result[j];
        result[j] = rowPtr;

        int tmp = perm[goodRow]; // and swap perm info
        perm[goodRow] = perm[j];
        perm[j] = tmp;

        toggle = -toggle; // adjust the row-swap toggle
      }
      // --------------------------------------------------
      // if diagonal after swap is zero . .
      //if (Math.Abs(result[j][j]) less-than 1.0E-20)
      //  return null; // consider a throw

      for (int i = j + 1; i < n; ++i)
      {
        result[i][j] /= result[j][j];
        for (int k = j + 1; k < n; ++k)
        {
          result[i][k] -= result[i][j] * result[j][k];
        }
      }


    } // main j column loop

    return result;
  } // MatrixDecompose
  //////////////////////////////////

  //////////////////////////////////
  static double[] HelperSolve(double[][] luMatrix, double[] b)
  {
    // before calling this helper, permute b using the perm array
    // from MatrixDecompose that generated luMatrix
    int n = luMatrix.Length;
    double[] x = new double[n];
    b.CopyTo(x, 0);

    for (int i = 1; i < n; ++i)
    {
      double sum = x[i];
      for (int j = 0; j < i; ++j)
      {
        sum -= luMatrix[i][j] * x[j];
      }
      x[i] = sum;
    }

    x[n - 1] /= luMatrix[n - 1][n - 1];
    for (int i = n - 2; i >= 0; --i)
    {
      double sum = x[i];
      for (int j = i + 1; j < n; ++j)
      {
        sum -= luMatrix[i][j] * x[j];
      }
      x[i] = sum / luMatrix[i][i];
    }

    return x;
  }
  //////////////////////////////////

  //////////////////////////////////
  //returns "string" or "double[][]"
  static dynamic MatrixInverse_Grasshopper(DataTree<double> matrix)
  {
    IList<List<double>> matrix_Branches = matrix.Branches;
    int rows = matrix_Branches.Count; int cols = matrix_Branches[0].Count; // assume square

    //Tree into [][] Start//
    double[][] matrix_TtoM = MatrixCreate(rows, cols);
    for(int i = 0; i < rows; i++)
    {
      for(int j = 0; j < cols; j++)
      {
        matrix_TtoM[i][j] = matrix_Branches[i][j];
      }
    }
    //Tree into [][] End//

    int n = matrix.BranchCount;
    double[][] result = matrix_TtoM;

    int[] perm;
    int toggle;
    string state;
    double[][] lum = MatrixDecompose_Grasshopper(matrix, out perm, out toggle, out state);

    if (lum == null)
    {
      return "Unable to compute inverse";
    }

    double[] b = new double[n];
    for (int i = 0; i < n; ++i)
    {
      for (int j = 0; j < n; ++j)
      {
        if (i == perm[j])
          b[j] = 1.0;
        else
          b[j] = 0.0;
      }

      double[] x = HelperSolve(lum, b); //

      for (int j = 0; j < n; ++j)
        result[j][i] = x[j];
    }
    return result;
  }
  //////////////////////////////////
  // Resource#1: https://jamesmccaffrey.wordpress.com/2015/03/06/inverting-a-matrix-using-c/
  // Resource#2: https://en.wikipedia.org/wiki/LU_decomposition
  // Resource#3: https://www.youtube.com/watch?v=dza5JTvMpzk
  // Resource#4: http://home.cc.umanitoba.ca/~farhadi/Math2120/Inverse%20Using%20LU%20decomposition.pdf
  // Editor: Taeyong Kim.
# ---------- end c_matrix_inverse_matrix ----------
c_matrix_a_dot_product_b_3 = CSharpScript(Tree_axb_Matrix=c_randommatrix_10.A, Tree_bxa_Matrix=c_matrix_inverse_matrix.A)  # -> out, A; inputs Tree_axb_Matrix: tree of Double, Tree_bxa_Matrix: tree of Double
# ---------- c_matrix_a_dot_product_b_3: C# ----------
    if(MatrixProduct_Grasshopper(Tree_axb_Matrix, Tree_bxa_Matrix).GetType() == typeof(string))
    {
      A = "Non-conformable matrices";
    }
    else
    {
      double[][] m = MatrixProduct_Grasshopper(Tree_axb_Matrix, Tree_bxa_Matrix);

      //////Define Tree//////
      DataTree < double > doubleTree = new DataTree<double>();

      // Raws = Branches
      for(int i = 0; i < m.Length;i++)
      {
        GH_Path pth = new GH_Path(i);

        // Cols = Index
        for (int j = 0; j < m[i].Length;j++)
        {
          doubleTree.Add(m[i][j], pth);
        }
      }
      //////Define Tree End//////

      A = doubleTree;
    }
# ---------- c_matrix_a_dot_product_b_3: C# additional code ----------
  static double[][] MatrixCreate(int rows, int cols)
  {
    double[][] result = new double[rows][];

    for (int i = 0; i < rows; ++i)
    {
      result[i] = new double[cols];
    }
    return result;
  }

  //returns "string" or "double[][]"
  static dynamic MatrixProduct_Original(double[][] matrixA, double[][] matrixB)
  {
    int aRows = matrixA.Length; int aCols = matrixA[0].Length;
    int bRows = matrixB.Length; int bCols = matrixB[0].Length;
    if (aCols != bRows)
    {
      return "Non-conformable matrices";
    }

    double[][] result = MatrixCreate(aRows, bCols);

    for (int i = 0; i < aRows; ++i) // each row of A
      for (int j = 0; j < bCols; ++j) // each col of B
        for (int k = 0; k < aCols; ++k) // could use k less-than bRows
          result[i][j] += matrixA[i][k] * matrixB[k][j];

    //Parallel.For(0, aRows, i =greater-than
    //  {
    //    for (int j = 0; j less-than bCols; ++j) // each col of B
    //      for (int k = 0; k less-than aCols; ++k) // could use k less-than bRows
    //        result[i][j] += matrixA[i][k] * matrixB[k][j];
    //  }
    //);

    return result;
  }

  //returns "string" or "DataTree<double>"
  static dynamic MatrixProduct_Grasshopper(DataTree<double> matrixA, DataTree<double> matrixB)
  {
    IList<List<double>> matrixA_Branches = matrixA.Branches;
    int aRows = matrixA_Branches.Count; int aCols = matrixA_Branches[0].Count;

    IList<List<double>> matrixB_Branches = matrixB.Branches;
    int bRows = matrixB_Branches.Count; int bCols = matrixB_Branches[0].Count;

    if (aCols != bRows)
    {
      return "Non-conformable matrices";
    }

    double[][] result = MatrixCreate(aRows, bCols);

    for (int i = 0; i < aRows; ++i) // each row of A
    {
      for (int j = 0; j < bCols; ++j) // each col of B
      {
        for (int k = 0; k < aCols; ++k) // could use k less-than bRows
        {
          result[i][j] += matrixA_Branches[i][k] * matrixB_Branches[k][j];
        }
      }
    }

    //Parallel.For(0, aRows, i =greater-than
    //  {
    //    for (int j = 0; j less-than bCols; ++j) // each col of B
    //      for (int k = 0; k less-than aCols; ++k) // could use k less-than bRows
    //        result[i][j] += matrixA[i][k] * matrixB[k][j];
    //  }
    //);

    return result;
  }
  // Resource#1: https://jamesmccaffrey.wordpress.com/2015/03/06/inverting-a-matrix-using-c/
  // Resource#2: https://en.wikipedia.org/wiki/Matrix_multiplication
  // Editor: Taeyong Kim.
# ---------- end c_matrix_a_dot_product_b_3 ----------
panel_9 = Panel(c_matrix_a_dot_product_b_3.A)
